# Grasshopper definition sound-blobs.gh (Grasshopper 1.0.7)
# plug-ins: Weaverbird

# ---- group: Random Datapoints
number_of_data_points = Slider(255, range=0..255)
random = Random(Range=Domain(0, 1), Number=number_of_data_points, Seed=2)

# ----
panel = Panel("/Users/adithyaravi/Documents/Spring 2020/Generative Design/adiSounds/r.txt")
ghpython_script = GhPythonScript(path=panel, resolution=Slider(10, range=0..10))  # -> out, a
# ---------- ghpython_script: Python ----------
__author__ = "zap"
import csv
import rhinoscriptsyntax as rs

output = []

with open(path, 'r') as csvfile:
    csvReader = csv.reader(csvfile, delimiter=',', quotechar='"')
    for row in csvReader:
        for i in range(len(row)):
            if i%resolution == 0 : 
                output.append(row[i])
                
        
a = output
# ---------- end ghpython_script ----------

# ---- group: Spread Out Points on X-Axis
list_length = ListLength(List=ghpython_script.a)
range = Range(Domain=Slider(25, range=0..100), Steps=list_length)

# ----
number_slider = Slider(180, range=0..1000)
construct_domain = ConstructDomain(DomainStart=expr("-x", number_slider), DomainEnd=number_slider)
list_length_2 = ListLength(List=ghpython_script.a)
range_2 = Range(Domain=construct_domain, Steps=list_length_2)

# ---- group: Remap Amplitudes
number_slider_2 = Slider(90, range=0..1000)
construct_domain_2 = ConstructDomain(DomainStart=expr("-x", number_slider_2), DomainEnd=number_slider_2)
bounds = Bounds(Numbers=ghpython_script.a)
remap_numbers = RemapNumbers(Value=ghpython_script.a, Source=bounds, Target=construct_domain_2)  # -> Mapped, Clipped

number_slider_3 = Slider(10, range=0..10)
construct_domain_3 = ConstructDomain(DomainStart=expr("-x", number_slider_3), DomainEnd=number_slider_3)
bounds_2 = Bounds(Numbers=ghpython_script.a)
remap_numbers_2 = RemapNumbers(Value=ghpython_script.a, Source=bounds_2, Target=construct_domain_3)  # -> Mapped, Clipped

# ---- group: Spread Out Data
length_of_folded_strip = Slider(100, range=0..100)
range_3 = Range(Domain=length_of_folded_strip, Steps=expr("x-1", number_of_data_points))

# ----
mass_addition = MassAddition(Input=ghpython_script.a)  # -> Result, PartialResults

# ---- group: Sound Globes?
number_slider_4 = Slider(2.5, range=0..10)
point_polar = PointPolar(BasePlane=PlaneXY(0, 0, 0), XYAngle=degrees(range_2), ZAngle=degrees(remap_numbers.Mapped), Offset=number_slider_4)
sphere = Sphere(Base=PlaneXY(0, 0, 0), Radius=number_slider_4)
shift_list = ShiftList(List=point_polar, Shift=1, Wrap=True)
geodesic = Geodesic(Surface=sphere, Start=point_polar, End=shift_list)

# ----
power = Power(A=mass_addition.PartialResults, B=Slider(2, range=0..10))
construct_point = ConstructPoint(XCoordinate=range, YCoordinate=remap_numbers_2.Mapped, ZCoordinate=0)

# ---- group: Simplify Wave List
sift_pattern = SiftPattern(List=construct_point, SiftPattern=[0, 0, 1, 1])  # -> Output0, Output1
random_reduce = RandomReduce(List=construct_point, Seed=1)

# ---- group: Vornooi Dome
list_length_3 = ListLength(List=construct_point)
random_2 = Random(Range=Slider(8, range=0..10), Number=list_length_3, Seed=2)
unit_z = UnitZ(Factor=random_2)
move = Move(Geometry=construct_point, Motion=unit_z)  # -> Geometry, Transform
bounding_box = BoundingBox(Content=move.Geometry, Plane=PlaneXY(0, 0, 0), UnionBox=True)  # -> Box, Box_2
facet_dome = FacetDome(Points=move.Geometry, Box=bounding_box.Box)  # -> Pattern, Dome

# ----
division = Division(A=power, B=Slider(100000000, range=0..100000000))

# ---- group: Network
proximity_2d = Proximity2D(Points=construct_point, Plane=PlaneXY(0, 0, 0), Group=Slider(4, range=0..100))  # -> Links, Topology

# ---- group: Simplify Line
polyline = PolyLine(Vertices=construct_point, Closed=False)
smooth_polyline = SmoothPolyline(Polyline=polyline, Strength=Slider(1, range=0..1), Times=1)

# ---- group: Voronoi Cells
bounding_box_2 = BoundingBox(Content=construct_point, Plane=PlaneXY(0, 0, 0), UnionBox=True)  # -> Box, Box_2
xy_plane = XYPlane(Origin=Point(0, 0, 0))
voronoi = Voronoi(Points=construct_point, Boundary=bounding_box_2.Box, Plane=xy_plane, BruteForceOverride=False)

# ---- group: Bounding Polygon
convex_hull = ConvexHull(Points=construct_point, Plane=PlaneXY(0, 0, 0))  # -> Hull, HullZ, Indices

# ---- group: Mesh points
delaunay_mesh = DelaunayMesh(Points=construct_point, Plane=PlaneXY(0, 0, 0))

# ----
strip_width = Slider(3.1, range=0..10)

discontinuity = Discontinuity(Curve=convex_hull.Hull, Level=1)  # -> Points, Parameters
deconstruct = Deconstruct(Point=discontinuity.Points)  # -> XComponent, YComponent, ZComponent
sort_list = SortList(Keys=deconstruct.XComponent, ValuesValuesA=discontinuity.Points)  # -> Keys, ValuesValuesA
nurbs_curve = NurbsCurve(Vertices=sort_list.ValuesValuesA, Degree=3, Periodic=False)  # -> Curve, Length, Domain

# ---- group: Make wave more lyrical
discontinuity_2 = Discontinuity(Curve=smooth_polyline, Level=1)  # -> Points, Parameters
nurbs_curve_2 = NurbsCurve(Vertices=discontinuity_2.Points, Degree=Slider(10, range=0..10), Periodic=False)  # -> Curve, Length, Domain

# ---- group: Smoothed Mesh
weaverbird_s_catmull_clark_subdivision = WeaverbirdsCatmullClarkSubdivision(MeshCurves=delaunay_mesh, Level=Slider(3, range=0..10), SmoothNakedEdges=1)

# ----
curve_closest_point = CurveClosestPoint(Point=construct_point, Curve=convex_hull.Hull)  # -> Point, Parameter, Distance
smaller_than = SmallerThan(FirstNumber=curve_closest_point.Distance, SecondNumber=Slider(0.5, range=0..10))  # -> SmallerThan, OrEqualTo
cull_pattern = CullPattern(List=curve_closest_point.Point, CullPattern=smaller_than.SmallerThan)
deconstruct_2 = Deconstruct(Point=cull_pattern)  # -> XComponent, YComponent, ZComponent
sort_list_2 = SortList(Keys=deconstruct_2.XComponent, ValuesValuesA=cull_pattern)  # -> Keys, ValuesValuesA
nurbs_curve_3 = NurbsCurve(Vertices=sort_list_2.ValuesValuesA, Degree=3, Periodic=False)  # -> Curve, Length, Domain

# ---- group: Shift Folded Pattern Back for Visibility
addition = Addition(A=strip_width, B=Slider(3, range=0..10))

# ---- group: Best One!
geometry = Geometry([convex_hull.Hull, nurbs_curve.Curve])

geometry_2 = Geometry([convex_hull.Hull, nurbs_curve_3.Curve])

# ---- group: Generate Folding Angle
fold_angle = Slider(224, range=0..300)
unit_z_2 = UnitZ(Factor=1)
xz_plane = XZPlane(Origin=Point(0, 0, 0))

# ----
random_3 = Random(Range=Domain(0, 1), Number=fold_angle, Seed=2)

# ---- group: Generate Folding Angle (continued)
radians = Radians(Degrees=random_3)
negative = Negative(Value=radians)
rotate = Rotate(Geometry=unit_z_2, Angle=negative, Plane=xz_plane)  # -> Geometry, Transform

# ---- group: Draw outwards-facing pleat edges
construct_point_2 = ConstructPoint(XCoordinate=range_3, YCoordinate=0, ZCoordinate=0)
line_sdl = LineSDL(Start=construct_point_2, Direction=rotate.Geometry, Length=division)

# ---- group: Draw hidden pleat edges
shift_list_2 = ShiftList(List=line_sdl, Shift=1, Wrap=False)
end_points = EndPoints(Curve=line_sdl)  # -> Start, End
end_points_2 = EndPoints(Curve=shift_list_2)  # -> Start, End
line = Line(StartPoint=end_points.End, EndPoint=end_points_2.Start)

# ---- group: Pleated / Extrude Paper
join_curves = JoinCurves(Curves=flatten([line, line_sdl]), Preserve=False)
unit_y = UnitY(Factor=strip_width)
extrude = Extrude(Base=join_curves, Direction=unit_y)

# ---- group: Plot Fold Lines
length = Length(Curve=line)
weave = Weave(Pattern=[0, 1], Stream0=division, Stream1=length, NullGaps=False)
mass_addition_2 = MassAddition(Input=weave)  # -> Result, PartialResults
insert_items = InsertItems(List=mass_addition_2.PartialResults, Item=0, Indices=0, Wrap=True)
construct_point_3 = ConstructPoint(XCoordinate=insert_items, YCoordinate=addition, ZCoordinate=0)

# ---- group: Pleated / Color Alternating Fold Edges
brep_edges = BrepEdges(Brep=extrude)  # -> Naked, Interior, NonManifold
shift_list_3 = ShiftList(List=brep_edges.Interior, Shift=1, Wrap=True)
dispatch = Dispatch(List=shift_list_3, DispatchPattern=[True, False])  # -> ListA, ListB
custom_preview = CustomPreview(Geometry=dispatch.ListA, Material=ColourSwatch(SwatchColor=RGB(0, 68, 255)))
custom_preview_2 = CustomPreview(Geometry=dispatch.ListB, Material=ColourSwatch(SwatchColor=RGB(255, 48, 48)))

# ---- group: Color Alternating Fold Lines
unit_y_2 = UnitY(Factor=1)
line_sdl_2 = LineSDL(Start=construct_point_3, Direction=unit_y_2, Length=strip_width)
dispatch_2 = Dispatch(List=line_sdl_2, DispatchPattern=[True, False])  # -> ListA, ListB
custom_preview_3 = CustomPreview(Geometry=dispatch_2.ListA, Material=ColourSwatch(SwatchColor=RGB(0, 68, 255)))
custom_preview_4 = CustomPreview(Geometry=dispatch_2.ListB, Material=ColourSwatch(SwatchColor=RGB(255, 48, 48)))

# ---- group: Pleated
custom_preview_5 = CustomPreview(Geometry=extrude, Material=ColourSwatch(SwatchColor=RGB(217, 217, 217)))

# ----
loft = Loft(Curves=line_sdl_2, Options={Adjust=False, Closed=False, LoftEnds=0, LoftSimp=0, LoftType=0, Rebuild=10, Refit=0.01})
custom_preview_6 = CustomPreview(Geometry=loft, Material=ColourSwatch(SwatchColor=RGB(217, 217, 217)))

# ---- group: Physical Forces
xy_plane_2 = XYPlane(Origin=Point(0, 0, 0))
range_4 = Range(Domain=Slider(10, range=0..10), Steps=Slider(38, range=0..100))

# ---- group: Physical Forces / Panel will always be red, don’t worry, still works
metaball_t = MetaBallT(Points=construct_point, Plane=xy_plane_2, Threshold=range_4)

# ---- group: Physical Forces (continued)
curve = Curve(metaball_t)
